# Grasshopper definition depthscanner_ghpython.gh (Grasshopper 1.0.7)
# plug-ins: Docofossor

# ---- group: dfScan
scan = GhPythonScript(start=Toggle(False))  # -> out, df; inputs start: Boolean
# ---------- scan: Python ----------
"""Scans the sandbox using the Docofossor format using the Intel Realsense D415
    Inputs:
        start: Start the scan
    Output:
        df: The Docofossor list"""

__author__     = ['Ilmar Hurkxkens']
__license__    = 'MIT License'
__email__      = ['hurkxkens@arch.ethz.ch']

# install the depthscanner package to use this script: 
# https://github.com/ilmihur/depthscanner.git

from compas.rpc import Proxy

if start:
    depthscanner = Proxy('depthscanner', python='C:\Users\ilmi\Anaconda3\envs\dev27\python')
    df = depthscanner.dfScan()
    Proxy.stop_server(depthscanner)
# ---------- end scan ----------

# ---- group: pcScan
scan_2 = GhPythonScript(start=Toggle(False))  # -> out, points; inputs start: Boolean
# ---------- scan_2: Python ----------
import compas
import compas_rhino
import rhinoscriptsyntax as rs

from compas.rpc import Proxy

from compas_ghpython import unload_modules
unload_modules('depthscanner')

if start:

    ## make the function available as a wrapped function.
    depthscanner = Proxy('depthscanner', python='C:\Users\ilmi\Anaconda3\envs\dev27\python')
    
    ## start the scan
    pts = depthscanner.pcScan()
    
    ## stop the server so scan.py will be reloaded
    Proxy.stop_server(depthscanner)

    ## convert the list to points and add to pointcloud
    points = []
    for i in pts:
        pnt = rs.CreatePoint(i[0],i[1],i[2])
        points.append(pnt)
        
    print('Successfully captured ' + str(len(points)) + ' points.')
# ---------- end scan_2 ----------

# ----
panel = Panel(scan.out)
grid_mesh = GridMesh(Df=scan.df)
panel_2 = Panel(scan_2.out)
